# Grasshopper definition curved_brick_wall_02.gh (Grasshopper 1.0.7)

# ---- group: RH_IN:y_dim
number_slider = Slider(1.6, range=0..100)

# ---- group: RH_IN:x_dim
# You should group the inputs and give them a name with the following format: RH_IN:inputName
number_slider_2 = Slider(6.1, range=0..100)

# ---- group: RH_IN:z_dim
number_slider_3 = Slider(2.1, range=0..10)

# ----
unit_z = UnitZ(Factor=1)
surface = Surface(reparameterize(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))
point = Point(Point(55.41915688, -18.4780059, 0))
contour = Contour(Shape=surface, Point=point, Direction=unit_z, Distance=number_slider_3)
curve = Curve(flatten(contour))
number_slider_4 = Slider(19, range=0..100)
dispatch = Dispatch(List=curve, DispatchPattern=[True, False])  # -> ListA, ListB
curve_2 = Curve(dispatch.ListA)
curve_3 = Curve(dispatch.ListB)
horizontal_frames = HorizontalFrames(Curve=curve_2, Count=number_slider_4)  # -> Frames, Parameters
horizontal_frames_2 = HorizontalFrames(Curve=curve_3, Count=number_slider_4)  # -> Frames, Parameters
dispatch_2 = Dispatch(List=horizontal_frames.Frames, DispatchPattern=[True, False])  # -> ListA, ListB
# It is probably best to output meshes instead of Box or Brep because you need meshes to visualize the geometry in the browser.
panel = Panel("1")
dispatch_3 = Dispatch(List=horizontal_frames_2.Frames, DispatchPattern=[True, False])  # -> ListA, ListB
domain_box = DomainBox(Base=PlaneXY(0, 0, 0), X=number_slider_2, Y=number_slider, Z=number_slider_3)
plane = Plane(dispatch_2.ListA)
mbox = MeshBox(Base=domain_box, XCount=panel, YCount=panel, ZCount=panel)
plane_2 = Plane(dispatch_3.ListB)
deconstruct_brep = DeconstructBrep(Brep=domain_box)  # -> Faces, Edges, Vertices
list_item = ListItem(List=deconstruct_brep.Faces, Index=Slider(4, range=0..10), Wrap=True)
area = Area(Geometry=list_item)  # -> Area, Centroid
xy_plane = XYPlane(Origin=area.Centroid)
plane_3 = Plane([plane, plane_2])
orient = Orient(Geometry=mbox, Source=xy_plane, Target=plane_3)  # -> Geometry, Transform
geo = Geometry(orient.Geometry)

# ---- group: RH_OUT:meshes
# You should group the outputs and give them a name with the following format: RH_OUT:outputName
mesh = Mesh(flatten(orient.Geometry))

# ----
panel_2 = Panel(mesh)
